% Simulink data dictionary AudioFilterSystem_dict.sldd

AnalogAudio_IF = Simulink.ConnectionBus()
Analog_Audio_IF = Simulink.ValueType(DataType="double", be=Simulink.BusElement(Name="a", DataType="double"))
DigitalSample_IF = Simulink.ValueType(DataType="int16", be=Simulink.BusElement(Name="a", DataType="double"))
FilteredSample_IF = Simulink.ValueType(DataType="double", be=Simulink.BusElement(Name="a", DataType="double"))