# Requirement set SystemRequirements (R2025a)

## 1 [#1] (Container)
Functional Requirements

### 1.1 [#2]
FR-01 The system shall acquire audio from an analog microphone.

### 1.2 [#7]
FR-02 The system shall convert the analog audio into digital samples using an ADC.

### 1.3 [#8]
FR-03 The system shall perform a band-stop FIR filter on the digital samples.

### 1.4 [#9]
FR-04 The system shall operate in continuous real-time mode.

### 1.5 [#10]
FR-05 The system shall output the filtered digital audio stream.

## 2 [#3] (Container)
Performance Requirements

### 2.1 [#11]
PR-01 The system shall support audio bandwidth up to 10 kHz.

### 2.2 [#12]
PR-02 The system shall use a sampling rate of 16 kHz.

### 2.3 [#13]
PR-03 The FIR filter shall implement a band-stop notch at 1 kHz ± 200 Hz.

### 2.4 [#14]
PR-04 The filter attenuation at stopband shall be ≥ 40 dB.

### 2.5 [#15]
PR-05 The processing latency shall be ≤ 1 sample period.

## 3 [#4] (Container)
Hardware Requirements

### 3.1 [#16]
HR-01 The system shall run on a TI MSP432P401R microcontroller.

### 3.2 [#17]
HR-02 The system shall use a microphone compatible with ADC input.

### 3.3 [#18]
HR-03 The system shall support floating-point FIR filtering.

## 4 [#5] (Container)
Interface Requirements

### 4.1 [#19]
IR-01 The system shall interface with the microphone via analog input.

### 4.2 [#20]
IR-02 The system shall interface with validation tools via digital debug output.

## 5 [#6] (Container)
Development Requirements

### 5.1 [#21] (Informational)
DR-01 The system shall use Model-Based Design techniques.

### 5.2 [#22] (Informational)
DR-02 The system shall follow a V-Model development workflow.

### 5.3 [#25] (Informational)
DR-03 The system shall maintain traceability from requirements to test cases.

### 5.4 [#26] (Informational)
DR-04 The system shall maintain source control using Git/GitHub.